# Grasshopper definition GHFunken_0_2_0.gh (Grasshopper 0.9.76)
# plug-ins: Python Interpreter

export = Fnk_ExportUserObjects(UO="*", DIR="D:\Funken", RUN=Toggle(False))  # -> out, a; inputs UO: list, RUN: Boolean
# ---------- export: Python ----------
#########################################################################
##                            COMPONENT INFO                           ##
#########################################################################

"""
Description + license here
-
Provided by Wasp 0.0.02
    Args:
        UO: Description...
        DIR: Description...
        RUN: Description...
    Returns:
        log: log
"""

ghenv.Component.Name = "Fnk_Export User Objects"
ghenv.Component.NickName = 'Export'
ghenv.Component.Message = 'VER 0.0.03\nSEP_18_2017'
ghenv.Component.IconDisplayMode = ghenv.Component.IconDisplayMode.name
ghenv.Component.Category = ""
ghenv.Component.SubCategory = ""
try: ghenv.Component.AdditionalHelpFromDocStrings = "1"
except: pass



#########################################################################
##                               IMPORTS                               ##
#########################################################################
import Grasshopper.Folders as folders
import Grasshopper.Kernel as gh
import scriptcontext as sc
import shutil
import os
import uuid

UOFolder = folders.UserObjectFolders[0]
cs = gh.GH_ComponentServer()

exposureDict = {0 : ghenv.Component.Exposure.dropdown,
                1 : ghenv.Component.Exposure.primary,
                2 : ghenv.Component.Exposure.secondary,
                3 : ghenv.Component.Exposure.tertiary,
                4 : ghenv.Component.Exposure.quarternary,
                5 : ghenv.Component.Exposure.quinary,
                6 : ghenv.Component.Exposure.senary,
                7 : ghenv.Component.Exposure.septenary
                }


def exportToUserObject(component, targetFolder):
    targetFolder = os.path.join(targetFolder, "userObjects")
    if not os.path.isdir(targetFolder): os.mkdir(targetFolder)
    
    # check if the userObject is already existed in the folder
    try:
        filePath = os.path.join(UOFolder, component.Name + ".ghuser")
        currentUO = gh.GH_UserObject(filePath)
    except:
        # the userobject is not there so just create it
        currentUO = None
    
    if currentUO!=None:
        if not component.Category == "Maths":
            removeNicely = cs.RemoveCachedObject(filePath)
            if not removeNicely: os.remove(filePath)
        else:
            # there is already a newer version so just copy that to the folder instead
            # and return
            dstFullPath = os.path.join(targetFolder, component.Name + ".ghuser")
            shutil.copy2(filePath, dstFullPath)
            return
    
    # create the new userObject in Grasshopper folder
    uo = gh.GH_UserObject()
    uo.Icon = component.Icon_24x24
    
    try: uo.Exposure = exposureDict[int(component.AdditionalHelpFromDocStrings)]
    except:
        try:
            compCode = component.Code
            # this is so dirty
            exposureNumber = compCode.split("ghenv.Component.AdditionalHelpFromDocStrings")[1].split("\n")[0].replace("=", "").replace('"', "").strip()
            uo.Exposure = exposureDict[int(exposureNumber)]
            
        except:
            uo.Exposure = exposureDict[int(1)]
    
    uo.BaseGuid = component.ComponentGuid
    uo.Description.Name = component.Name
    uo.Description.Description = component.Description
    
    # if user hasn't identified the category then put it into honeybee as an unknown!
    if component.Category == "Maths":
        uo.Description.Category = "Honeybee"
    else:
        uo.Description.Category = component.Category
        
    if component.SubCategory == "Script":
        uo.Description.SubCategory = "UnknownBees"
    else:
        uo.Description.SubCategory = component.SubCategory
    
    uo.CreateDefaultPath(True)
    uo.SetDataFromObject(component)
    uo.SaveToFile()
    
    # copy the component over
    dstFullPath = os.path.join(targetFolder, component.Name + ".ghuser")
    shutil.copy2(filePath, dstFullPath)
    
    gh.GH_ComponentServer.UpdateRibbonUI()
    
    print "UserObject successfully added to: "

def exportToFile(component, targetFolder):
    
    targetFolder = os.path.join(targetFolder, "src")
    if not os.path.isdir(targetFolder): os.mkdir(targetFolder)
    
    if component.Name.find("Funken")>=0:
        
        fileName = component.Name + ".py"
        
        # code inside the component
        code = component.Code
        
        # check if the file already exist
        if os.path.isfile(os.path.join(targetFolder, fileName)):
            return False
        
        with open(os.path.join(targetFolder, fileName), "w") as pyoutf:
            if isinstance(code, unicode):
                code = code.encode('ascii','ignore').replace("\r", "")
            pyoutf.write(code)
        
        print "Exported " + fileName + " to: " + os.path.join(targetFolder, fileName)
        return True

def getListOfConnectedComponents(componentInputParamIndex = 0, onlyGHPython = True):
    # this function is edited version of Guilio's code from here:
    # [github link]
    components = []
    
    param = ghenv.Component.Params.Input[componentInputParamIndex]
    sources = param.Sources
    if sources.Count == 0: return components
    
    for source in sources:
        attr = source.Attributes
        if (attr is None) or (attr.GetTopLevel is None):
            pass
        else:
            component = attr.GetTopLevel.DocObject
    
    if component == None or (onlyGHPython and type(component) != type(ghenv.Component)):
            #collect only python components
            pass
    else:
        components.append(component)
    
    return components

def getAllTheComponents(onlyGHPython = True):
    components = []
    
    document = ghenv.Component.OnPingDocument()
    
    for component in document.Objects:
        if onlyGHPython and type(component)!= type(ghenv.Component):
            pass
        else:
            components.append(component)
    
    return components


def main(components, targetFolder):
    if not os.path.isdir(targetFolder): os.mkdir(targetFolder)
        
    if components[0] == "*":
        ghComps = getAllTheComponents()
    else:
        ghComps = getListOfConnectedComponents()
    
    if len(ghComps)== 0: return "Found 0 components!"
    
    for ghComp in ghComps:
        fileExported = exportToFile(ghComp, targetFolder)
        if fileExported:
            exportToUserObject(ghComp, targetFolder)


if RUN and len(UO)!=0 and DIR!=None:
    msg = main(UO, DIR)
    ghenv.Component.AddRuntimeMessage(gh.GH_RuntimeMessageLevel.Warning, msg)
else:
    print "At the minimum one of the components are missing!"
# ---------- end export ----------
panel = Panel(export.a)

setupfnk = Funken_SetupFunken(RUN=Toggle(True))  # -> log
# ---------- setupfnk: Python ----------
#########################################################################
##                            COMPONENT INFO                           ##
#########################################################################

"""
Description + license here
-
Provided by Funken 0.1
    Args:
        RUN: run me!!!
    Returns:
        log: log
"""

ghenv.Component.Name = "Funken_Setup Funken"
ghenv.Component.NickName = 'SetupFnk'
ghenv.Component.Message = 'VER 0.2.0'
ghenv.Component.IconDisplayMode = ghenv.Component.IconDisplayMode.application
ghenv.Component.Category = "Funken"
ghenv.Component.SubCategory = "0 | Funken"
try: ghenv.Component.AdditionalHelpFromDocStrings = "1"
except: pass



import serial
import scriptcontext as sc
import time


def handle_funken_response(txt):
    
    if txt[0] != "<":
        return None
    
    for char in "<>\rn":
       txt = txt.replace(char, "")
    
    parsed = txt.split(":")
    
    device_id = int(parsed[1])
    comm_token = str(parsed[2])
    try:
        comm_val = str(parsed[3].strip("\n"))
    except:
        comm_val = None
    
    return device_id, comm_token, comm_val


## generic device connected to a serial port
class Device(object):
    
    def __init__(self, id):
        self.id = id
        self.tokens = {}
    
    def register_tokens(self, txt):
        
        parsed_tokens = txt.split(" ")
        
        for tok in parsed_tokens:
            if tok not in self.tokens:
                self.tokens[tok] = None

class SerialConnection(object):
    
    def __init__(self, port, baudrate):
        self.port = port
        self.ser = serial.Serial(port, baudrate)  # open serial port
        
        self.devices = {}
    
    def register_devices(self):
        self.ser.write(b"GETID\n")
        time.sleep(0.1)
        while self.ser.in_waiting:
            response = self.ser.readline()
            parsed_response = handle_funken_response(response)
            if parsed_response is not None:
                if parsed_response[1] == "GETID":
                    if parsed_response[0] not in self.devices:
                        self.devices[parsed_response[0]] = Device(parsed_response[0])
        
        time.sleep(0.1)
        for key in self.devices:
            self.ser.write(b"CLIST\n")
            time.sleep(0.1)
            while self.ser.in_waiting:
                response = self.ser.readline()
                parsed_response = handle_funken_response(response)
                if parsed_response is not None:
                    if parsed_response[1] == "CLIST":
                        if parsed_response[0] in self.devices:
                            self.devices[parsed_response[0]].register_tokens(parsed_response[2])


class Listener(object):
    
    def __init__(self, com_ports, baudrates = [230400]):
        self.com_ports = com_ports
        
        self.ser_conn = {}
        
        for i in xrange(len(self.com_ports)):
            #set baudrate
            baud = None
            if len(baudrates) == 1:
                baud = baudrates[0]
            else:
                baud = baudrates[i]
            #create serial connection
            self.ser_conn[self.com_ports[i]] = SerialConnection(self.com_ports[i], baud)
       
    def add_serial_connection(self, port, baudrate = 230400):
       if port in self.com_ports:
           self.ser_conn[port].ser.close()
       self.ser_conn[port] = SerialConnection(port, baudrate)
       self.com_ports.append(port)
    
    def send_command(self, comm_txt, port, id):
        self.ser_conn[port].ser.write(comm_txt)
        time.sleep(0.005)
    
    def get_response(self, comm_txt, token, port, id):
        self.ser_conn[port].ser.write(comm_txt)
        time.sleep(0.005)
        while self.ser_conn[port].ser.in_waiting:
            response = self.ser_conn[port].ser.readline()
            parsed_response = handle_funken_response(response)
            if parsed_response is not None:
                if parsed_response[1] == token:
                    return parsed_response[2]
        return None

log = []

if RUN:
    sc.sticky['Listener'] = Listener
    sc.sticky['SerialConnection'] = SerialConnection
    sc.sticky['Device'] = Device
    
    sc.sticky['main_listener'] = Listener([])
    log.append("ready to go...")
# ---------- end setupfnk ----------
scanports = Funken_ScanSerialPorts(SCAN=Toggle(True))  # -> PORTS; inputs SCAN: Boolean
# ---------- scanports: Python ----------
#########################################################################
##                            COMPONENT INFO                           ##
#########################################################################

"""
Description + license here
-
Provided by Funken 0.1
    Args:
        SCAN: Description...
    Returns:
        PORTS: Description...
"""

ghenv.Component.Name = "Funken_Scan Serial Ports"
ghenv.Component.NickName = 'ScanPorts'
ghenv.Component.Message = 'VER 0.2.0'
ghenv.Component.IconDisplayMode = ghenv.Component.IconDisplayMode.application
ghenv.Component.Category = "Funken"
ghenv.Component.SubCategory = "0 | Funken"
try: ghenv.Component.AdditionalHelpFromDocStrings = "2"
except: pass


import scriptcontext as sc
import _winreg as winreg
import itertools


## https://eli.thegreenplace.net/2009/07/31/listing-all-serial-ports-on-windows-with-python/
def enumerate_serial_ports():
    """ Uses the Win32 registry to return an
        iterator of serial (COM) ports
        existing on this computer.
    """
    path = 'HARDWARE\\DEVICEMAP\\SERIALCOMM'
    try:
        key = winreg.OpenKey(winreg.HKEY_LOCAL_MACHINE, path)
    except WindowsError:
        return
        #raise IterationError
    ports = []
    for i in itertools.count():
        try:
            val = winreg.EnumValue(key, i)
            port_name = str(val[1])
            if port_name not in ports:
                ports.append(port_name)
        except EnvironmentError:
            break
    return ports

if SCAN:
    PORTS = enumerate_serial_ports()
# ---------- end scanports ----------
panel_2 = Panel(setupfnk)
panel_3 = Panel(scanports)
list_item = ListItem(List=panel_3, Index=Slider(0, range=0..20), Wrap=False)
list_item_2 = ListItem(List=panel_3, Index=Slider(1, range=0..20), Wrap=False)
arduino_com_port = Text(list_item)
arduino_com_port_2 = Text(arduino_com_port)
python = PythonScript(PORT=arduino_com_port_2, CLOSE=Button())  # -> out, a
# ---------- python: Python ----------
import scriptcontext as sc
import serial


if CLOSE:
    if PORT in sc.sticky.keys():
        sc.sticky[PORT].ser.close()
# ---------- end python ----------
arduino_com_port_3 = Text(list_item_2)
baudrate = ValueList({"300", "1200", "2400", "4800", "9600", "19200", "38400", "57600", "74880", "115200", "230400", "250000", "500000", "1000000", "2000000"}, selected="230400")
baudrate_2 = ValueList({"300", "1200", "2400", "4800", "9600", "19200", "38400", "57600", "74880", "115200", "230400", "250000", "500000", "1000000", "2000000"}, selected="57600")
pin_mode = ValueList({"INPUT": 0, "OUTPUT": 1}, selected="OUTPUT")
arduino_com_port_4 = Text(panel_3)
number_slider = Slider(202, range=0..255)
baudrate_3 = ValueList({"300", "1200", "2400", "4800", "9600", "19200", "38400", "57600", "74880", "115200", "230400", "250000", "500000", "1000000", "2000000"}, selected="57600")
arduino_com_port_5 = Text(arduino_com_port_3)
pin_mode_2 = ValueList({"INPUT": 0, "OUTPUT": 1}, selected="OUTPUT")
button = Button()
openport = Funken_OpenSerialPort(OPEN=Button(), PORT=arduino_com_port_4, BAUD=baudrate, REG=Button())  # -> out; inputs PORT: list, BAUD: list of Int32
# ---------- openport: Python ----------
#########################################################################
##                            COMPONENT INFO                           ##
#########################################################################

"""
Description + license here
-
Provided by Funken 0.1
    Args:
        OPEN: Description...
        PORT: Description...
        LISTEN: Description...
    Returns:
        log: Description...
"""

ghenv.Component.Name = "Funken_Open Serial Port"
ghenv.Component.NickName = 'OpenPort'
ghenv.Component.Message = 'VER 0.2.0'
ghenv.Component.IconDisplayMode = ghenv.Component.IconDisplayMode.application
ghenv.Component.Category = "Funken"
ghenv.Component.SubCategory = "0 | Funken"
try: ghenv.Component.AdditionalHelpFromDocStrings = "2"
except: pass

import scriptcontext as sc
import serial
import time


if OPEN:
    for i in xrange(len(PORT)):
        if len(BAUD) == 0:
            sc.sticky['main_listener'].add_serial_connection(PORT[i])
        elif len(BAUD) == 1:
            sc.sticky['main_listener'].add_serial_connection(PORT[i], BAUD[0])
        elif len(BAUD) == len(PORT):
            sc.sticky['main_listener'].add_serial_connection(PORT[i], BAUD[i])
        else:
            print "wrong number of comports and baudrates"
    
    ## try communication
if REG:
    if 'main_listener' in sc.sticky:
        for conn in sc.sticky['main_listener'].ser_conn:
            sc.sticky['main_listener'].ser_conn[conn].register_devices()
            print sc.sticky['main_listener'].ser_conn[conn].port, sc.sticky['main_listener'].ser_conn[conn].devices
            for device in sc.sticky['main_listener'].ser_conn[conn].devices:
                print sc.sticky['main_listener'].ser_conn[conn].devices[device].tokens
     

"""
else:
    ## reset all connection
    pass
"""
# ---------- end openport ----------
digitalwrite = Funken_DigitalWrite(PIN=Slider(13, range=0..100), VAL=Button(), PORT="COM9")  # -> out; inputs PIN: Int32, VAL: Int32
# ---------- digitalwrite: Python ----------
#########################################################################
##                            COMPONENT INFO                           ##
#########################################################################

"""
Description + license here
-
Provided by Funken 0.1
    Args:
        PIN: Description...
        VAL: Description...
        PORT: Description...
    Returns:
        VAL_OUT: Description...
"""

ghenv.Component.Name = "Funken_Digital Write"
ghenv.Component.NickName = 'DigitalWrite'
ghenv.Component.Message = 'VER 0.2.0'
ghenv.Component.IconDisplayMode = ghenv.Component.IconDisplayMode.application
ghenv.Component.Category = "Funken"
ghenv.Component.SubCategory = "0 | Funken"
try: ghenv.Component.AdditionalHelpFromDocStrings = "4"
except: pass

import scriptcontext as sc
import time

if PORT is None:
    PORT = sc.sticky['main_listener'].com_ports[0]

if ID is None:
    ID = 1

comm = "DW " + str(PIN) + " " + str(VAL) + "\n"
sc.sticky['main_listener'].send_command(comm, PORT, ID)
# ---------- end digitalwrite ----------
pinmode = Funken_SetPinMode(PIN=Slider(13, range=0..100), MODE=pin_mode, SET=Button(), PORT="COM9")  # -> out, log; inputs MODE: Int32, SET: Boolean, ID: Int32
# ---------- pinmode: Python ----------
#########################################################################
##                            COMPONENT INFO                           ##
#########################################################################

"""
Description + license here
-
Provided by Funken 0.1
    Args:
        PIN: Description...
        MODE: Description...
        SET: Description...
        PORT: Description...
    Returns:
        log: Description...
"""

ghenv.Component.Name = "Funken_Set PinMode"
ghenv.Component.NickName = 'PinMode'
ghenv.Component.Message = 'VER 0.2.0'
ghenv.Component.IconDisplayMode = ghenv.Component.IconDisplayMode.application
ghenv.Component.Category = "Funken"
ghenv.Component.SubCategory = "0 | Funken"
try: ghenv.Component.AdditionalHelpFromDocStrings = "3"
except: pass

import scriptcontext as sc
import time


if SET:
    
    if PORT is None:
        PORT = sc.sticky['main_listener'].com_ports[0]
    
    if ID is None:
        ID = 1
    
    comm = "PM " + str(PIN) + " " + str(MODE) + "\n"
    sc.sticky['main_listener'].send_command(comm, PORT, ID)
    if MODE == 0:
        comm_act = "DW " + str(PIN) + " 1\n"
        sc.sticky['main_listener'].send_command(comm, PORT, ID)
# ---------- end pinmode ----------
openport_2 = Funken_OpenSerialPort(OPEN=Button(), PORT=arduino_com_port_5, BAUD=baudrate_3, REG=Button())  # -> out; inputs PORT: list, BAUD: list of Int32
# ---------- openport_2: Python ----------
#########################################################################
##                            COMPONENT INFO                           ##
#########################################################################

"""
Description + license here
-
Provided by Funken 0.1
    Args:
        OPEN: Description...
        PORT: Description...
        LISTEN: Description...
    Returns:
        log: Description...
"""

ghenv.Component.Name = "Funken_Open Serial Port"
ghenv.Component.NickName = 'OpenPort'
ghenv.Component.Message = 'VER 0.2.0'
ghenv.Component.IconDisplayMode = ghenv.Component.IconDisplayMode.application
ghenv.Component.Category = "Funken"
ghenv.Component.SubCategory = "0 | Funken"
try: ghenv.Component.AdditionalHelpFromDocStrings = "2"
except: pass

import scriptcontext as sc
import serial
import time


if OPEN:
    #if 'main_listener' not in sc.sticky:
    if len(BAUD) == 0:
        sc.sticky['main_listener'] = sc.sticky['Listener'](PORT)
        print sc.sticky['main_listener'].com_ports
    else:
        sc.sticky['main_listener'] = sc.sticky['Listener'](PORT, BAUD)
    
    ## try communication
if REG:
    if 'main_listener' in sc.sticky:
        for conn in sc.sticky['main_listener'].ser_conn:
            sc.sticky['main_listener'].ser_conn[conn].register_devices()
            print sc.sticky['main_listener'].ser_conn[conn].port, sc.sticky['main_listener'].ser_conn[conn].devices
            for device in sc.sticky['main_listener'].ser_conn[conn].devices:
                print sc.sticky['main_listener'].ser_conn[conn].devices[device].tokens
     

"""
else:
    ## reset all connection
    pass
"""
# ---------- end openport_2 ----------
pinmode_2 = Funken_SetPinMode(PIN=Slider(13, range=0..100), MODE=pin_mode_2, SET=Button(), PORT="COM8")  # -> out, log; inputs MODE: Int32, SET: Boolean, ID: Int32; same code as pinmode
panel_4 = Panel(openport)
panel_5 = Panel(openport_2)
pin_mode_3 = ValueList({"INPUT": 0, "OUTPUT": 1}, selected="OUTPUT")
digitalwrite_2 = Funken_DigitalWrite(PIN=Slider(13, range=0..100), VAL=Button(), PORT="COM7")  # -> out; inputs PIN: Int32, VAL: Int32; same code as digitalwrite
pinmode_3 = Funken_SetPinMode(PIN=Slider(13, range=0..100), MODE=pin_mode_3, SET=Button(), PORT="COM7")  # -> out, log; inputs MODE: Int32, SET: Boolean, ID: Int32; same code as pinmode
pin_mode_4 = ValueList({"INPUT": 0, "OUTPUT": 1}, selected="INPUT")
button_2 = Button()
timer = Timer(TimerInterval=20, Target=[digitalread, analogread])  # disabled
analogread = Funken_AnalogRead(PIN=Slider(0, range=0..100), GET=Toggle(True), PORT="COM9")  # -> out, VAL; inputs PIN: Int32, GET: Boolean
# ---------- analogread: Python ----------
#########################################################################
##                            COMPONENT INFO                           ##
#########################################################################

"""
Description + license here
-
Provided by Funken 0.1
    Args:
        PIN: Description...
        VAL: Description...
        PORT: Description...
    Returns:
        VAL_OUT: Description...
"""

ghenv.Component.Name = "Funken_Analog Read"
ghenv.Component.NickName = 'AnalogRead'
ghenv.Component.Message = 'VER 0.2.0'
ghenv.Component.IconDisplayMode = ghenv.Component.IconDisplayMode.application
ghenv.Component.Category = "Funken"
ghenv.Component.SubCategory = "0 | Funken"
try: ghenv.Component.AdditionalHelpFromDocStrings = "4"
except: pass

import scriptcontext as sc
import time

if GET:
    if PORT is None:
        PORT = sc.sticky['main_listener'].com_ports[0]
    
    if ID is None:
        ID = 1
    
    comm = "AR " + str(PIN) + "\n"
    response = sc.sticky['main_listener'].get_response(comm, "AR", PORT, ID)
    try:
        VAL = int(response.split(" ")[1])
    except:
        VAL = -1
# ---------- end analogread ----------
digitalread = Funken_DigitalRead(PIN=Slider(8, range=0..100), GET=Toggle(True), PORT="COM9")  # -> out, VAL; inputs PIN: Int32, GET: Boolean
# ---------- digitalread: Python ----------
#########################################################################
##                            COMPONENT INFO                           ##
#########################################################################

"""
Description + license here
-
Provided by Funken 0.1
    Args:
        PIN: Description...
        VAL: Description...
        PORT: Description...
    Returns:
        VAL_OUT: Description...
"""

ghenv.Component.Name = "Funken_Digital Read"
ghenv.Component.NickName = 'DigitalRead'
ghenv.Component.Message = 'VER 0.2.0'
ghenv.Component.IconDisplayMode = ghenv.Component.IconDisplayMode.application
ghenv.Component.Category = "Funken"
ghenv.Component.SubCategory = "0 | Funken"
try: ghenv.Component.AdditionalHelpFromDocStrings = "4"
except: pass

import scriptcontext as sc
import time

if GET:
    if PORT is None:
        PORT = sc.sticky['main_listener'].com_ports[0]
    
    if ID is None:
        ID = 1
    
    comm = "DR " + str(PIN) + "\n"
    response = sc.sticky['main_listener'].get_response(comm, "DR", PORT, ID)
    try:
        VAL = int(response.split(" ")[1])
    except:
        VAL = -1
# ---------- end digitalread ----------
subtraction = Subtraction(A=Slider(1, range=0..1), B=digitalread.VAL)
digitalwrite_3 = Funken_DigitalWrite(PIN=Slider(13, range=0..100), VAL=subtraction, PORT="COM8")  # -> out; inputs PIN: Int32, VAL: Int32; same code as digitalwrite
pinmode_4 = Funken_SetPinMode(PIN=Slider(8, range=0..100), MODE=pin_mode_4, SET=Button(), PORT="COM9")  # -> out, log; inputs MODE: Int32, SET: Boolean, ID: Int32
# ---------- pinmode_4: Python ----------
#########################################################################
##                            COMPONENT INFO                           ##
#########################################################################

"""
Description + license here
-
Provided by Funken 0.1
    Args:
        PIN: Description...
        MODE: Description...
        SET: Description...
        PORT: Description...
    Returns:
        log: Description...
"""

ghenv.Component.Name = "Funken_Set PinMode"
ghenv.Component.NickName = 'PinMode'
ghenv.Component.Message = 'VER 0.2.0'
ghenv.Component.IconDisplayMode = ghenv.Component.IconDisplayMode.application
ghenv.Component.Category = "Funken"
ghenv.Component.SubCategory = "0 | Funken"
try: ghenv.Component.AdditionalHelpFromDocStrings = "3"
except: pass

import scriptcontext as sc
import time


if SET:
    
    if PORT is None:
        PORT = sc.sticky['main_listener'].com_ports[0]
    
    if ID is None:
        ID = 1
    
    comm = "PM " + str(PIN) + " " + str(MODE) + "\n"
    sc.sticky['main_listener'].send_command(comm, PORT, ID)
    if MODE == 0:
        comm_act = "DW " + str(PIN) + " 1\n"
        sc.sticky['main_listener'].send_command(comm_act, PORT, ID)
# ---------- end pinmode_4 ----------
remap = RemapNumbers(Value=analogread.VAL, Source=Slider(1023, range=0..10000), Target=Slider(255, range=0..1000))  # -> Mapped, Clipped

number_slider_2 = Slider(66, range=0..255)
pin_mode_5 = ValueList({"INPUT": 0, "OUTPUT": 1}, selected="OUTPUT")
analogwrite = Funken_AnalogWrite(PIN=Slider(10, range=0..10), VAL=remap.Mapped, PORT="COM9")  # -> out, a, VAL_OUT; inputs PIN: Int32, VAL: Int32
# ---------- analogwrite: Python ----------
#########################################################################
##                            COMPONENT INFO                           ##
#########################################################################

"""
Description + license here
-
Provided by Funken 0.1
    Args:
        PIN: Description...
        VAL: Description...
        PORT: Description...
    Returns:
        VAL_OUT: Description...
"""

ghenv.Component.Name = "Funken_Analog Write"
ghenv.Component.NickName = 'AnalogWrite'
ghenv.Component.Message = 'VER 0.1\nNOV_30_2017'
ghenv.Component.IconDisplayMode = ghenv.Component.IconDisplayMode.application
ghenv.Component.Category = "Funken"
ghenv.Component.SubCategory = "0 | Funken"
try: ghenv.Component.AdditionalHelpFromDocStrings = "4"
except: pass

import scriptcontext as sc
import time

if PORT is None:
    PORT = sc.sticky['main_listener'].com_ports[0]

if ID is None:
    ID = 1

comm = "AW " + str(PIN) + " " + str(VAL) + "\n"
sc.sticky['main_listener'].send_command(comm, PORT, ID)
# ---------- end analogwrite ----------
pinmode_5 = Funken_SetPinMode(PIN=Slider(10, range=0..100), MODE=pin_mode_5, SET=Button())  # -> out, log; inputs MODE: Int32, SET: Boolean, ID: Int32; same code as pinmode

analogwrite_2 = Funken_AnalogWrite(PIN=Slider(5, range=0..10), VAL=remap.Mapped, PORT="COM8")  # -> out, a, VAL_OUT; inputs PIN: Int32, VAL: Int32; same code as analogwrite
panel_6 = Panel(digitalread.VAL)
panel_7 = Panel(analogread.VAL)
number_slider_3 = Slider(1, range=0..10)
merge = Merge(Data1=Slider(8, range=0..100))
timer_2 = Timer(TimerInterval=20, Target=customcomm)  # disabled
customcomm = Funken_CustomCommand(TOKEN="GETID", RETURN=Toggle(False), PORT="COM9")  # -> out, V_OUT; inputs VAL: list, RETURN: Boolean
# ---------- customcomm: Python ----------
#########################################################################
##                            COMPONENT INFO                           ##
#########################################################################

"""
Description + license here
-
Provided by Funken 0.1
    Args:
        PIN: Description...
        VAL: Description...
        PORT: Description...
    Returns:
        VAL_OUT: Description...
"""

ghenv.Component.Name = "Funken_CustomCommand"
ghenv.Component.NickName = 'CustomComm'
ghenv.Component.Message = 'VER 0.2.0'
ghenv.Component.IconDisplayMode = ghenv.Component.IconDisplayMode.application
ghenv.Component.Category = "Funken"
ghenv.Component.SubCategory = "0 | Funken"
try: ghenv.Component.AdditionalHelpFromDocStrings = "4"
except: pass

import scriptcontext as sc
import time

if PORT is None:
    PORT = sc.sticky['main_listener'].com_ports[0]

if ID is None:
    ID = 1

comm = TOKEN

for v in VAL:
    comm = comm + " " + v

comm = comm + "\n"

if RETURN is None or RETURN == False:
    sc.sticky['main_listener'].send_command(comm, PORT, ID)
else:
    response = sc.sticky['main_listener'].get_response(comm, TOKEN, PORT, ID)
    V_OUT = response
# ---------- end customcomm ----------
panel_8 = Panel(customcomm.V_OUT)
