# Grasshopper definition GHFunken_0_3_3.gh (Grasshopper 1.0.7)

export = Fnk_ExportUserObjects(UO="*", DIR="D:\GitHub\GhFunken", RUN=Toggle(False))  # -> out, a; inputs UO: list, RUN: Boolean
# ---------- export: Python ----------
#########################################################################
##                            COMPONENT INFO                           ##
#########################################################################

"""
Description + license here
-
Provided by Wasp 0.0.02
    Args:
        UO: Description...
        DIR: Description...
        RUN: Description...
    Returns:
        log: log
"""

ghenv.Component.Name = "Fnk_Export User Objects"
ghenv.Component.NickName = 'Export'
ghenv.Component.Message = 'VER 0.0.03\nSEP_18_2017'
ghenv.Component.IconDisplayMode = ghenv.Component.IconDisplayMode.name
ghenv.Component.Category = ""
ghenv.Component.SubCategory = ""
try: ghenv.Component.AdditionalHelpFromDocStrings = "1"
except: pass



#########################################################################
##                               IMPORTS                               ##
#########################################################################
import Grasshopper.Folders as folders
import Grasshopper.Kernel as gh
import scriptcontext as sc
import shutil
import os
import uuid

UOFolder = folders.UserObjectFolders[0]
cs = gh.GH_ComponentServer()

exposureDict = {0 : ghenv.Component.Exposure.dropdown,
                1 : ghenv.Component.Exposure.primary,
                2 : ghenv.Component.Exposure.secondary,
                3 : ghenv.Component.Exposure.tertiary,
                4 : ghenv.Component.Exposure.quarternary,
                5 : ghenv.Component.Exposure.quinary,
                6 : ghenv.Component.Exposure.senary,
                7 : ghenv.Component.Exposure.septenary
                }


def exportToUserObject(component, targetFolder):
    targetFolder = os.path.join(targetFolder, "userObjects")
    if not os.path.isdir(targetFolder): os.mkdir(targetFolder)
    
    # check if the userObject is already existed in the folder
    try:
        filePath = os.path.join(UOFolder, component.Name + ".ghuser")
        currentUO = gh.GH_UserObject(filePath)
    except:
        # the userobject is not there so just create it
        currentUO = None
    
    if currentUO!=None:
        if not component.Category == "Maths":
            removeNicely = cs.RemoveCachedObject(filePath)
            if not removeNicely: os.remove(filePath)
        else:
            # there is already a newer version so just copy that to the folder instead
            # and return
            dstFullPath = os.path.join(targetFolder, component.Name + ".ghuser")
            shutil.copy2(filePath, dstFullPath)
            return
    
    # create the new userObject in Grasshopper folder
    uo = gh.GH_UserObject()
    uo.Icon = component.Icon_24x24
    
    try: uo.Exposure = exposureDict[int(component.AdditionalHelpFromDocStrings)]
    except:
        try:
            compCode = component.Code
            # this is so dirty
            exposureNumber = compCode.split("ghenv.Component.AdditionalHelpFromDocStrings")[1].split("\n")[0].replace("=", "").replace('"', "").strip()
            uo.Exposure = exposureDict[int(exposureNumber)]
            
        except:
            uo.Exposure = exposureDict[int(1)]
    
    uo.BaseGuid = component.ComponentGuid
    uo.Description.Name = component.Name
    uo.Description.Description = component.Description
    
    # if user hasn't identified the category then put it into honeybee as an unknown!
    if component.Category == "Maths":
        uo.Description.Category = "Honeybee"
    else:
        uo.Description.Category = component.Category
        
    if component.SubCategory == "Script":
        uo.Description.SubCategory = "UnknownBees"
    else:
        uo.Description.SubCategory = component.SubCategory
    
    uo.CreateDefaultPath(True)
    uo.SetDataFromObject(component)
    uo.SaveToFile()
    
    # copy the component over
    dstFullPath = os.path.join(targetFolder, component.Name + ".ghuser")
    shutil.copy2(filePath, dstFullPath)
    
    gh.GH_ComponentServer.UpdateRibbonUI()
    
    print "UserObject successfully added to: "

def exportToFile(component, targetFolder):
    
    targetFolder = os.path.join(targetFolder, "src/ghComp")
    if not os.path.isdir(targetFolder): os.mkdir(targetFolder)
    
    if component.Name.find("Funken")>=0:
        
        fileName = component.Name + ".py"
        
        # code inside the component
        code = component.Code
        
        # check if the file already exist
        if os.path.isfile(os.path.join(targetFolder, fileName)):
            return False
        
        with open(os.path.join(targetFolder, fileName), "w") as pyoutf:
            if isinstance(code, unicode):
                code = code.encode('ascii','ignore').replace("\r", "")
            pyoutf.write(code)
        
        print "Exported " + fileName + " to: " + os.path.join(targetFolder, fileName)
        return True

def getListOfConnectedComponents(componentInputParamIndex = 0, onlyGHPython = True):
    # this function is edited version of Guilio's code from here:
    # [github link]
    components = []
    
    param = ghenv.Component.Params.Input[componentInputParamIndex]
    sources = param.Sources
    if sources.Count == 0: return components
    
    for source in sources:
        attr = source.Attributes
        if (attr is None) or (attr.GetTopLevel is None):
            pass
        else:
            component = attr.GetTopLevel.DocObject
    
    if component == None or (onlyGHPython and type(component) != type(ghenv.Component)):
            #collect only python components
            pass
    else:
        components.append(component)
    
    return components

def getAllTheComponents(onlyGHPython = True):
    components = []
    
    document = ghenv.Component.OnPingDocument()
    
    for component in document.Objects:
        if onlyGHPython and type(component)!= type(ghenv.Component):
            pass
        else:
            components.append(component)
    
    return components


def main(components, targetFolder):
    if not os.path.isdir(targetFolder): os.mkdir(targetFolder)
        
    if components[0] == "*":
        ghComps = getAllTheComponents()
    else:
        ghComps = getListOfConnectedComponents()
    
    if len(ghComps)== 0: return "Found 0 components!"
    
    for ghComp in ghComps:
        fileExported = exportToFile(ghComp, targetFolder)
        if fileExported:
            exportToUserObject(ghComp, targetFolder)


if RUN and len(UO)!=0 and DIR!=None:
    msg = main(UO, DIR)
    ghenv.Component.AddRuntimeMessage(gh.GH_RuntimeMessageLevel.Warning, msg)
else:
    print "At the minimum one of the components are missing!"
# ---------- end export ----------
panel = Panel(export.out)

arduino_com_port = Text()
python = PythonScript(PORT=arduino_com_port, CLOSE=Button())  # -> out, a
# ---------- python: Python ----------
import scriptcontext as sc
import serial


if CLOSE:
    if PORT in sc.sticky.keys():
        sc.sticky[PORT].ser.close()
# ---------- end python ----------

# ----
# OPEN PORT
scanports = Funken_ScanSerialPorts(SCAN=Toggle(True))  # -> PORTS; inputs SCAN: Boolean
# ---------- scanports: Python ----------
#########################################################################
##                            COMPONENT INFO                           ##
#########################################################################

"""
Scan for available serial ports.
-
Provided by Funken 0.3
    Args:
        SCAN: True to scan for available serial ports.
    Returns:
        PORTS: Available serial ports.
"""

ghenv.Component.Name = "Funken_Scan Serial Ports"
ghenv.Component.NickName = 'ScanPorts'
ghenv.Component.Message = 'VER 0.3.3'
ghenv.Component.IconDisplayMode = ghenv.Component.IconDisplayMode.application
ghenv.Component.Category = "Funken"
ghenv.Component.SubCategory = "0 | Funken"
try: ghenv.Component.AdditionalHelpFromDocStrings = "1"
except: pass

import platform
import Grasshopper as gh


## SERIAL PORT SCAN - WINDOWS
## https://eli.thegreenplace.net/2009/07/31/listing-all-serial-ports-on-windows-with-python/
def enumerate_serial_ports_win():
    """ Uses the Win32 registry to return an
        iterator of serial (COM) ports
        existing on this computer.
    """
    
    import _winreg as winreg
    import itertools
    
    path = 'HARDWARE\\DEVICEMAP\\SERIALCOMM'
    try:
        key = winreg.OpenKey(winreg.HKEY_LOCAL_MACHINE, path)
    except WindowsError:
        return
        #raise IterationError
    ports = []
    for i in itertools.count():
        try:
            val = winreg.EnumValue(key, i)
            port_name = str(val[1])
            if port_name not in ports:
                ports.append(port_name)
        except EnvironmentError:
            break
    return ports

## SERIAL PORT SCAN - MAC
def enumerate_serial_ports_mac():
    import glob
    ports = glob.glob("/dev/tty.*")
    return ports


if SCAN:
    os_name = platform.system()
    
    if os_name == "Darwin":
        PORTS = enumerate_serial_ports_mac()
    else:
        try:
            PORTS = enumerate_serial_ports_win()
        except:
            msg = "Your operative system is currently not supported by Funken.\n You might try to write the name of the serial port manually to the OpenPort component."
            ghenv.Component.AddRuntimeMessage(gh.Kernel.GH_RuntimeMessageLevel.Error, msg)
# ---------- end scanports ----------
panel_2 = Panel(scanports)
list_item = ListItem(List=panel_2, Index=Slider(0, range=0..20), Wrap=False)
arduino_com_port_2 = Text(list_item)

baudrates = Funken_Baudrates({"300", "1200", "2400", "4800", "9600", "19200", "38400", "57600", "74880", "115200", "230400", "250000", "500000", "1000000", "2000000"}, selected="57600")
arduino_com_port_3 = Text(panel_2)
openport = Funken_OpenSerialPort(PORT=arduino_com_port_3, BAUD=baudrates, OPEN=Button(), REG=Button())  # -> LOG; inputs PORT: list, BAUD: list of Int32, OPEN: Boolean
# ---------- openport: Python ----------
#########################################################################
##                            COMPONENT INFO                           ##
#########################################################################

"""
Open a serial port and register avaialble Funken devices.
-
Provided by Funken 0.3
    Args:
        
        PORT: Serial port to open.
        BAUD: Communication baudrate [Funken default: 57600].
        OPEN: True to open the port for communication.
        REG: Register devices to access available Funken commands. Sometimes the connection takes some time to be established, so you might need to press this button 2-3 times.
    Returns:
        LOG: Information about connected devices.
"""

ghenv.Component.Name = "Funken_Open Serial Port"
ghenv.Component.NickName = 'OpenPort'
ghenv.Component.Message = 'VER 0.3.3'
ghenv.Component.IconDisplayMode = ghenv.Component.IconDisplayMode.application
ghenv.Component.Category = "Funken"
ghenv.Component.SubCategory = "0 | Funken"
try: ghenv.Component.AdditionalHelpFromDocStrings = "1"
except: pass


import sys
import scriptcontext as sc
import Grasshopper as gh
import time

## add Funken install directory to system path
ghcompfolder = gh.Folders.DefaultAssemblyFolder
fnk_path = ghcompfolder + "GhFunken"
if fnk_path not in sys.path:
    sys.path.append(fnk_path)
try:
    import funken
except:
    msg = "Cannot import Funken. Is the funken.py module installed in " + fnk_path + "?"
    ghenv.Component.AddRuntimeMessage(gh.Kernel.GH_RuntimeMessageLevel.Error, msg)


def main(ports, bauds, open, register, log):
    
    check_data = True
    
    if len(ports) == 0:
        check_data = False
        msg = "No serial port provided."
        ghenv.Component.AddRuntimeMessage(gh.Kernel.GH_RuntimeMessageLevel.Warning, msg)
    
    if len(bauds) == 0:
        bauds = [57600]
    
    elif len(bauds) > 1 and len(bauds) != len(ports):
        check_data = False
        msg = "Wrong number of comports and baudrates."
        ghenv.Component.AddRuntimeMessage(gh.Kernel.GH_RuntimeMessageLevel.Error, msg)
    
    if open is None:
        open = False
    
    if register is None:
        register = False
    
    if check_data:
        
        if sc.sticky.has_key("pyFunken") == False:
            sc.sticky['pyFunken'] = funken.PyFunken([],[])
        
        if open:
            log = ""
            for i in xrange(len(ports)):
                if ports[i] is not None:
                    baud = None
                    if len(bauds) == 1:
                        baud = bauds[0]
                    else:
                        baud = bauds[i]
                    try:
                        sc.sticky['pyFunken'].add_serial_connection(ports[i], baud)
                        log = log + str(ports[i]) + ":\n" + "No Funken device registered\n"
                        log = log + "---\n"
                    except:
                        log = log + str(ports[i]) + ":\n" + "Could not open the serial port\n"
                        log = log + "---\n"
        
        if register:
            log = ""
            for port in ports:
                try:
                    sc.sticky['pyFunken'].ser_conn[port].register_devices()
                    log = log + str(sc.sticky['pyFunken'].ser_conn[port].port) + ":\n"
                    if len(sc.sticky['pyFunken'].ser_conn[port].devices) > 0:
                        for device in sc.sticky['pyFunken'].ser_conn[port].devices:
                            log = log + str(device) + ":" + str(sc.sticky['pyFunken'].ser_conn[port].devices[device].tokens.keys()) + "\n"
                    else:
                        log = log + "No Funken device available\n"
                
                except:
                    log = log + str(port) + ":\n" + "Could not open the serial port\n"
                    
                log = log + "---\n"
    
    ## test if available serial ports are still active
    if sc.sticky.has_key("pyFunken"):
        
        ## remove port names if no longer in use
        for port in sc.sticky['pyFunken'].com_ports:
            if sc.sticky['pyFunken'].ser_conn.has_key(port) == False:
                sc.sticky['pyFunken'].com_ports =  filter(lambda a: a != port, sc.sticky['pyFunken'].com_ports)
        
        ## remove serial connections if no longer available
        removed_keys = []
        for port in sc.sticky['pyFunken'].ser_conn:
            for device in sc.sticky['pyFunken'].ser_conn[port].devices:
                try:
                    sc.sticky['pyFunken'].send_command("TEST", port, device)
                except:
                    removed_keys.append(port)
                    if port in sc.sticky['pyFunken'].com_ports:
                        sc.sticky['pyFunken'].com_ports.remove(port) 
                    break
        for key in removed_keys:
            sc.sticky['pyFunken'].ser_conn.pop(key)
    
    return log


if 'logger' not in globals():
    logger = ""

logger = main(PORT, BAUD, OPEN, REG, logger)
LOG = logger
# ---------- end openport ----------
panel_3 = Panel(openport)

pinmode = Funken_PinModes({"INPUT": 0, "OUTPUT": 1}, selected="INPUT")
# READ
pinmode_2 = Funken_SetPinMode(PIN=Slider(2, range=0..100), MODE=pinmode, SET=Button())  # -> COMM, PORT, ID; inputs MODE: Int32, SET: Boolean, ID: Int32
# ---------- pinmode_2: Python ----------
#########################################################################
##                            COMPONENT INFO                           ##
#########################################################################

"""
Set pin mode (mirrors the Arduino pinMode method).
-
Provided by Funken 0.3
    Args:
        PIN: The number of the pin whose mode you wish to set.
        MODE: 0 for Input pins, 1 for Output pins.
        SET: True to set the pin.
        PORT: Serial port to send the message [Default is the first port available].
        ID: ID of the device [Default is the first device available].
    Returns:
        _COMM: Funken command.
        _PORT: Serial port where the message was sent (for daisy-chaining). 
        _ID: Device ID (for daisy-chaining). 
"""

ghenv.Component.Name = "Funken_Set PinMode"
ghenv.Component.NickName = 'PinMode'
ghenv.Component.Message = 'VER 0.3.3'
ghenv.Component.IconDisplayMode = ghenv.Component.IconDisplayMode.application
ghenv.Component.Category = "Funken"
ghenv.Component.SubCategory = "1 | Arduino"
try: ghenv.Component.AdditionalHelpFromDocStrings = "1"
except: pass

import scriptcontext as sc
import Grasshopper as gh

def main(pin, mode, set, port, id):
    
    check_data = True
    
    if sc.sticky.has_key("pyFunken") == False:
        check_data = False
        msg = "No serial object available. Have you opened the serial port?"
        ghenv.Component.AddRuntimeMessage(gh.Kernel.GH_RuntimeMessageLevel.Warning, msg)
        return
    
    if pin is None:
        check_data = False
        msg = "No pin provided."
        ghenv.Component.AddRuntimeMessage(gh.Kernel.GH_RuntimeMessageLevel.Warning, msg)
        return
    
    if mode is None:
        check_data = False
        msg = "No mode provided."
        ghenv.Component.AddRuntimeMessage(gh.Kernel.GH_RuntimeMessageLevel.Warning, msg)
        return
    
    if set is None:
        set = False
    
    if port is None:
        if len(sc.sticky["pyFunken"].com_ports) == 0:
            msg = "No serial connection available. Did you connect open the serial port?"
            ghenv.Component.AddRuntimeMessage(gh.Kernel.GH_RuntimeMessageLevel.Warning, msg)
            return
        else:
            port = sc.sticky["pyFunken"].com_ports[0]
    
    if id is None:
        if len(sc.sticky['pyFunken'].ser_conn[port].devices_ids) == 0:
            msg = "No device available. Did you connect an Arduino-compatible device and registered it?"
            ghenv.Component.AddRuntimeMessage(gh.Kernel.GH_RuntimeMessageLevel.Warning, msg)
            return
        else:
            id = sc.sticky['pyFunken'].ser_conn[port].devices_ids[0]
    
    if check_data:
        comm = "PM " + str(pin) + " " + str(mode) + "\n"
        if set:
            sc.sticky['pyFunken'].send_command(comm, port, id)
        
        return comm, port, id

result = main(PIN, MODE, SET, PORT, ID)

if result is not None:
    _COMM = result[0]
    _PORT = result[1]
    _ID = result[2]
# ---------- end pinmode_2 ----------
digitalread = Funken_DigitalRead(PIN=Slider(2, range=0..100), GET=Toggle(True))  # -> VAL, COMM, PORT, ID; inputs PIN: Int32, GET: Boolean
# ---------- digitalread: Python ----------
#########################################################################
##                            COMPONENT INFO                           ##
#########################################################################

"""
Read a digital input pin (mirrors the Arduino digitalRead method).
-
Provided by Funken 0.3
    Args:
        PIN: The number of the pin from which to read.
        GET: True to read data.
        PORT: Serial port to send the message [Default is the first port available].
        ID: ID of the device [Default is the first device available].
    Returns:
        VAL: Read value.
        _COMM: Funken command.
        _PORT: Serial port where the message was sent (for daisy-chaining). 
        _ID: Device ID (for daisy-chaining). 
"""

ghenv.Component.Name = "Funken_Digital Read"
ghenv.Component.NickName = 'DigitalRead'
ghenv.Component.Message = 'VER 0.3.3'
ghenv.Component.IconDisplayMode = ghenv.Component.IconDisplayMode.application
ghenv.Component.Category = "Funken"
ghenv.Component.SubCategory = "1 | Arduino"
try: ghenv.Component.AdditionalHelpFromDocStrings = "2"
except: pass

import scriptcontext as sc
import Grasshopper as gh
import time

def main(pin, get, port, id):
    
    if sc.sticky.has_key("pyFunken") == False:
        check_data = False
        msg = "No serial object available. Have you opened the serial port?"
        ghenv.Component.AddRuntimeMessage(gh.Kernel.GH_RuntimeMessageLevel.Warning, msg)
        return
    
    if pin is None:
        check_data = False
        msg = "No pin provided."
        ghenv.Component.AddRuntimeMessage(gh.Kernel.GH_RuntimeMessageLevel.Warning, msg)
        return
    
    if get is None:
        get = False
    
    if port is None:
        if len(sc.sticky["pyFunken"].com_ports) == 0:
            msg = "No serial connection available. Did you connect open the serial port?"
            ghenv.Component.AddRuntimeMessage(gh.Kernel.GH_RuntimeMessageLevel.Warning, msg)
            return
        else:
            port = sc.sticky["pyFunken"].com_ports[0]
    
    if id is None:
        if len(sc.sticky['pyFunken'].ser_conn[port].devices_ids) == 0:
            msg = "No device available. Did you connect an Arduino-compatible device and registered it?"
            ghenv.Component.AddRuntimeMessage(gh.Kernel.GH_RuntimeMessageLevel.Warning, msg)
            return
        else:
            id = sc.sticky['pyFunken'].ser_conn[port].devices_ids[0]
    
    value = None
    comm = "DR " + str(pin) + "\n"
    if get:
        response = sc.sticky['pyFunken'].get_response(comm, "DR", port, id)
        try:
            value = int(response.split(" ")[1])
        except:
            value = -1
        
    return value, comm, port, id

result = main(PIN, GET, PORT, ID)

if result is not None:
    VAL = result[0]
    _COMM = result[1]
    _PORT = result[2]
    _ID = result[3]
# ---------- end digitalread ----------
panel_4 = Panel(digitalread.VAL)

analogread = Funken_AnalogRead(PIN=Slider(0, range=0..100), GET=Toggle(True))  # -> VAL, COMM, PORT, ID; inputs PIN: Int32, GET: Boolean
# ---------- analogread: Python ----------
#########################################################################
##                            COMPONENT INFO                           ##
#########################################################################

"""
Read an analog input pin (mirrors the Arduino analogRead method).
-
Provided by Funken 0.3
    Args:
        PIN: The number of the pin from which to read.
        GET: True to read data.
        PORT: Serial port to send the message [Default is the first port available].
        ID: ID of the device [Default is the first device available].
    Returns:
        VAL: Read value.
        _COMM: Funken command.
        _PORT: Serial port where the message was sent (for daisy-chaining). 
        _ID: Device ID (for daisy-chaining). 
"""

ghenv.Component.Name = "Funken_Analog Read"
ghenv.Component.NickName = 'AnalogRead'
ghenv.Component.Message = 'VER 0.3.3'
ghenv.Component.IconDisplayMode = ghenv.Component.IconDisplayMode.application
ghenv.Component.Category = "Funken"
ghenv.Component.SubCategory = "1 | Arduino"
try: ghenv.Component.AdditionalHelpFromDocStrings = "2"
except: pass

import scriptcontext as sc
import Grasshopper as gh
import time

def main(pin, get, port, id):
    
    if sc.sticky.has_key("pyFunken") == False:
        check_data = False
        msg = "No serial object available. Have you opened the serial port?"
        ghenv.Component.AddRuntimeMessage(gh.Kernel.GH_RuntimeMessageLevel.Warning, msg)
        return
    
    if pin is None:
        check_data = False
        msg = "No pin provided."
        ghenv.Component.AddRuntimeMessage(gh.Kernel.GH_RuntimeMessageLevel.Warning, msg)
        return
    
    if get is None:
        get = False
    
    if port is None:
        if len(sc.sticky["pyFunken"].com_ports) == 0:
            msg = "No serial connection available. Did you connect open the serial port?"
            ghenv.Component.AddRuntimeMessage(gh.Kernel.GH_RuntimeMessageLevel.Warning, msg)
            return
        else:
            port = sc.sticky["pyFunken"].com_ports[0]
    
    if id is None:
        if len(sc.sticky['pyFunken'].ser_conn[port].devices_ids) == 0:
            msg = "No device available. Did you connect an Arduino-compatible device and registered it?"
            ghenv.Component.AddRuntimeMessage(gh.Kernel.GH_RuntimeMessageLevel.Warning, msg)
            return
        else:
            id = sc.sticky['pyFunken'].ser_conn[port].devices_ids[0]
    
    value = None
    comm = "AR " + str(pin) + "\n"
    if get:
        response = sc.sticky['pyFunken'].get_response(comm, "AR", port, id)
        try:
            value = int(response.split(" ")[1])
        except:
            value = -1
        
    return value, comm, port, id

result = main(PIN, GET, PORT, ID)

if result is not None:
    VAL = result[0]
    _COMM = result[1]
    _PORT = result[2]
    _ID = result[3]
# ---------- end analogread ----------
panel_5 = Panel(analogread.VAL)

timer = Timer(TimerInterval=20, Target=[digitalread, analogread])  # disabled

pinmode_3 = Funken_PinModes({"INPUT": 0, "OUTPUT": 1}, selected="OUTPUT")
# WRITE
pinmode_4 = Funken_SetPinMode(PIN=Slider(13, range=0..100), MODE=pinmode_3, SET=Button())  # -> COMM, PORT, ID; inputs MODE: Int32, SET: Boolean, ID: Int32; same code as pinmode_2
digitalwrite = Funken_DigitalWrite(PIN=Slider(13, range=0..100), VAL=Slider(1, range=0..1), SET=Toggle(True))  # -> COMM, PORT, ID; inputs PIN: Int32, VAL: Int32, SET: Boolean
# ---------- digitalwrite: Python ----------
#########################################################################
##                            COMPONENT INFO                           ##
#########################################################################

"""
Write a digital value on a pin (mirrors the Arduino digitalWrite method).
-
Provided by Funken 0.3
    Args:
        PIN: The number of the pin where to write.
        VAL: The value to write. It can be either 0 (LOW) or 1 (HIGH).
        SET: True to write the value to the Arduino pin.
        PORT: Serial port to send the message [Default is the first port available].
        ID: ID of the device [Default is the first device available].
    Returns:
        _COMM: Funken command.
        _PORT: Serial port where the message was sent (for daisy-chaining). 
        _ID: Device ID (for daisy-chaining). 
"""

ghenv.Component.Name = "Funken_Digital Write"
ghenv.Component.NickName = 'DigitalWrite'
ghenv.Component.Message = 'VER 0.3.3'
ghenv.Component.IconDisplayMode = ghenv.Component.IconDisplayMode.application
ghenv.Component.Category = "Funken"
ghenv.Component.SubCategory = "1 | Arduino"
try: ghenv.Component.AdditionalHelpFromDocStrings = "3"
except: pass

import scriptcontext as sc
import Grasshopper as gh
import time

def main(pin, value, set, port, id):
    
    if sc.sticky.has_key("pyFunken") == False:
        check_data = False
        msg = "No serial object available. Have you opened the serial port?"
        ghenv.Component.AddRuntimeMessage(gh.Kernel.GH_RuntimeMessageLevel.Warning, msg)
        return
    
    if pin is None:
        check_data = False
        msg = "No pin provided."
        ghenv.Component.AddRuntimeMessage(gh.Kernel.GH_RuntimeMessageLevel.Warning, msg)
        return
    
    if value is None:
        value = 0
    
    if set is None:
        set = False
    
    if port is None:
        if len(sc.sticky["pyFunken"].com_ports) == 0:
            msg = "No serial connection available. Did you connect open the serial port?"
            ghenv.Component.AddRuntimeMessage(gh.Kernel.GH_RuntimeMessageLevel.Warning, msg)
            return
        else:
            port = sc.sticky["pyFunken"].com_ports[0]
    
    if id is None:
        if len(sc.sticky['pyFunken'].ser_conn[port].devices_ids) == 0:
            msg = "No device available. Did you connect an Arduino-compatible device and registered it?"
            ghenv.Component.AddRuntimeMessage(gh.Kernel.GH_RuntimeMessageLevel.Warning, msg)
            return
        else:
            id = sc.sticky['pyFunken'].ser_conn[port].devices_ids[0]
    
    comm = "DW " + str(PIN) + " " + str(value) + "\n"
    if set:
        sc.sticky['pyFunken'].send_command(comm, port, id)
    
    return comm, port, id

result = main(PIN, VAL, SET, PORT, ID)

if result is not None:
    _COMM = result[0]
    _PORT = result[1]
    _ID = result[2]
# ---------- end digitalwrite ----------

pinmode_5 = Funken_PinModes({"INPUT": 0, "OUTPUT": 1}, selected="OUTPUT")
pinmode_6 = Funken_SetPinMode(PIN=Slider(9, range=0..100), MODE=pinmode_5, SET=Button())  # -> COMM, PORT, ID; inputs MODE: Int32, SET: Boolean, ID: Int32; same code as pinmode_2
analogwrite = Funken_AnalogWrite(PIN=Slider(9, range=0..10), VAL=Slider(36, range=0..255), SET=Toggle(True))  # -> COMM, PORT, ID; inputs PIN: Int32, VAL: Int32, SET: Boolean
# ---------- analogwrite: Python ----------
#########################################################################
##                            COMPONENT INFO                           ##
#########################################################################

"""
Write an analog value on a PWM pin (mirrors the Arduino analogWrite method).
-
Provided by Funken 0.3
    Args:
        PIN: The number of the pin where to write.
        VAL: The value to write. It can be an Integer between 0-255.
        SET: True to write the value to the Arduino pin.
        PORT: Serial port to send the message [Default is the first port available].
        ID: ID of the device [Default is the first device available].
    Returns:
        _COMM: Funken command.
        _PORT: Serial port where the message was sent (for daisy-chaining). 
        _ID: Device ID (for daisy-chaining). 
"""

ghenv.Component.Name = "Funken_Analog Write"
ghenv.Component.NickName = 'AnalogWrite'
ghenv.Component.Message = 'VER 0.3.3'
ghenv.Component.IconDisplayMode = ghenv.Component.IconDisplayMode.application
ghenv.Component.Category = "Funken"
ghenv.Component.SubCategory = "1 | Arduino"
try: ghenv.Component.AdditionalHelpFromDocStrings = "3"
except: pass

import scriptcontext as sc
import Grasshopper as gh
import time

def main(pin, value, set, port, id):
    
    if sc.sticky.has_key("pyFunken") == False:
        check_data = False
        msg = "No serial object available. Have you opened the serial port?"
        ghenv.Component.AddRuntimeMessage(gh.Kernel.GH_RuntimeMessageLevel.Warning, msg)
        return
    
    if pin is None:
        check_data = False
        msg = "No pin provided."
        ghenv.Component.AddRuntimeMessage(gh.Kernel.GH_RuntimeMessageLevel.Warning, msg)
        return
    
    if value is None:
        value = 0
    
    if set is None:
        set = False
    
    if port is None:
        if len(sc.sticky["pyFunken"].com_ports) == 0:
            msg = "No serial connection available. Did you connect open the serial port?"
            ghenv.Component.AddRuntimeMessage(gh.Kernel.GH_RuntimeMessageLevel.Warning, msg)
            return
        else:
            port = sc.sticky["pyFunken"].com_ports[0]
    
    if id is None:
        if len(sc.sticky['pyFunken'].ser_conn[port].devices_ids) == 0:
            msg = "No device available. Did you connect an Arduino-compatible device and registered it?"
            ghenv.Component.AddRuntimeMessage(gh.Kernel.GH_RuntimeMessageLevel.Warning, msg)
            return
        else:
            id = sc.sticky['pyFunken'].ser_conn[port].devices_ids[0]
    
    comm = "AW " + str(PIN) + " " + str(value) + "\n"
    if set:
        sc.sticky['pyFunken'].send_command(comm, port, id)
    
    return comm, port, id

result = main(PIN, VAL, SET, PORT, ID)

if result is not None:
    _COMM = result[0]
    _PORT = result[1]
    _ID = result[2]
# ---------- end analogwrite ----------

# ----
# CUSTOM
panel_6 = Panel("GETID")
customcomm = Funken_CustomCommand(TOKEN=panel_6, RES=Toggle(True), SEND=Button())  # -> OUT, OUT_RAW, COMM, PORT, ID; inputs VAL: list, RES: Boolean, SEND: Boolean
# ---------- customcomm: Python ----------
#########################################################################
##                            COMPONENT INFO                           ##
#########################################################################

"""
Send custom Funken commands.
-
Provided by Funken 0.3
    Args:
        TOKEN: Command identification token.
        VAL: Command parameters.
        RES: True if the command is expecting a response.
        SEND: True to send the command.
        PORT: Serial port to send the message [Default is the first port available].
        ID: ID of the device [Default is the first device available].
    Returns:
        OUT: Parsed command output (as list).
        OUT_RAW: Raw command output (as string).
        _COMM: Funken command.
        _PORT: Serial port where the message was sent (for daisy-chaining). 
        _ID: Device ID (for daisy-chaining). 
"""

ghenv.Component.Name = "Funken_CustomCommand"
ghenv.Component.NickName = 'CustomComm'
ghenv.Component.Message = 'VER 0.3.3'
ghenv.Component.IconDisplayMode = ghenv.Component.IconDisplayMode.application
ghenv.Component.Category = "Funken"
ghenv.Component.SubCategory = "2 | Custom"
try: ghenv.Component.AdditionalHelpFromDocStrings = "1"
except: pass

import scriptcontext as sc
import Grasshopper as gh
import time

def main(token, values, return_data, send_data, port, id):
    
    if sc.sticky.has_key("pyFunken") == False:
        check_data = False
        msg = "No serial object available. Have you opened the serial port?"
        ghenv.Component.AddRuntimeMessage(gh.Kernel.GH_RuntimeMessageLevel.Warning, msg)
        return
    
    if return_data is None:
        return_data = False
    
    if send_data is None:
        send_data = False
    
    if port is None:
        if len(sc.sticky["pyFunken"].com_ports) == 0:
            msg = "No serial connection available. Did you connect open the serial port?"
            ghenv.Component.AddRuntimeMessage(gh.Kernel.GH_RuntimeMessageLevel.Warning, msg)
            return
        else:
            port = sc.sticky["pyFunken"].com_ports[0]
    
    if id is None:
        if len(sc.sticky['pyFunken'].ser_conn[port].devices_ids) == 0:
            msg = "No device available. Did you connect an Arduino-compatible device and registered it?"
            ghenv.Component.AddRuntimeMessage(gh.Kernel.GH_RuntimeMessageLevel.Warning, msg)
            return
        else:
            id = sc.sticky['pyFunken'].ser_conn[port].devices_ids[0]
    
    response = None
    comm = token
    for v in values:
        comm = comm + " " + str(v)
    comm = comm + "\n"
    if send_data:
        if return_data:
            response = sc.sticky['pyFunken'].get_response(comm, token, port, id)
        else:
            sc.sticky['pyFunken'].send_command(comm, port, id)
    
    return response, comm, port, id


result = main(TOKEN, VAL, RES, SEND, PORT, ID)

if result is not None:
    OUT_RAW = result[0]
    if result[0] is not None:
        OUT = result[0].split(" ")
    else:
        OUT = None
    _COMM = result[1]
    _PORT = result[2]
    _ID = result[3]
# ---------- end customcomm ----------
panel_7 = Panel(customcomm.OUT)
panel_8 = Panel(customcomm.OUT_RAW)

# ----
# UTILITIES
statech = Funken_StateChange(VAL=Button())  # -> TF, FT
# ---------- statech: Python ----------
#########################################################################
##                            COMPONENT INFO                           ##
#########################################################################

"""
Checks for an input switching state.
-
Provided by Funken 0.3
    Args:
        VAL: Value to monitor
    Returns:
        TF: True when the value has switched from True to False
        FT: True when the value has switched from False to True
"""

ghenv.Component.Name = "Funken_State Change"
ghenv.Component.NickName = 'StateCh'
ghenv.Component.Message = 'VER 0.3.3'
ghenv.Component.IconDisplayMode = ghenv.Component.IconDisplayMode.application
ghenv.Component.Category = "Funken"
ghenv.Component.SubCategory = "3 | Utilities"
try: ghenv.Component.AdditionalHelpFromDocStrings = "1"
except: pass

import scriptcontext as sc
import Grasshopper as gh

check_data = True

if VAL is None:
    check_data = False
    msg = "No value provided"
    ghenv.Component.AddRuntimeMessage(gh.Kernel.GH_RuntimeMessageLevel.Warning, msg)
    
if check_data:
        
    if 'prev_value' not in globals():
        prev_value = False
    
    if VAL == True and prev_value != True:
        tf = False
        ft = True
    elif VAL == False and prev_value != False:
        ft = False
        tf = True
    else:
        tf = False
        ft = False
    
    prev_value = VAL
    
    TF = tf
    FT = ft
# ---------- end statech ----------
panel_9 = Panel(statech.TF)
panel_10 = Panel(statech.FT)

count = Funken_Counter(ADD=Button(), STEP=Slider(1, range=0..10), RESET=Button())  # -> C; inputs RESET: Boolean
# ---------- count: Python ----------
#########################################################################
##                            COMPONENT INFO                           ##
#########################################################################

"""
Simple counter
-
Provided by Funken 0.3
    Args:
        ADD: True to add a step to the counter
        STEP: step size
        RESET: True to reset the counter to 0
    Returns:
        C: Current counter value
"""

ghenv.Component.Name = "Funken_Counter"
ghenv.Component.NickName = 'Count'
ghenv.Component.Message = 'VER 0.3.3'
ghenv.Component.IconDisplayMode = ghenv.Component.IconDisplayMode.application
ghenv.Component.Category = "Funken"
ghenv.Component.SubCategory = "3 | Utilities"
try: ghenv.Component.AdditionalHelpFromDocStrings = "1"
except: pass

import scriptcontext as sc
import Grasshopper as gh

check_data = True

if ADD is None:
    ADD = False

if STEP is None:
    STEP = 1

if RESET is None:
    RESET = False

if check_data:
    
    if 'counter' not in globals() or RESET:
        counter = 0
    
    if ADD:
        counter += STEP
    
    C = counter
# ---------- end count ----------
panel_11 = Panel(count)
mod = Modulus(A=count, B=Slider(2, range=0..10))
bool = Boolean(mod)
panel_12 = Panel(bool)
