# Grasshopper definition 03_Servo.gh (Grasshopper 1.0.7)

number_slider = Slider(2, range=0..10)
pinmode = Funken_PinModes({"INPUT": 0, "OUTPUT": 1}, selected="INPUT")
servo_angle = Slider(90, range=0..180)
servo_num = Slider(1, range=1..3)
servo_pin = Slider(10, range=3..11)
scanports = Funken_ScanSerialPorts(SCAN=Toggle(True))  # -> PORTS; inputs SCAN: Boolean
# ---------- scanports: Python ----------
#########################################################################
##                            COMPONENT INFO                           ##
#########################################################################

"""
Scan for available serial ports.
-
Provided by Funken 0.3
    Args:
        SCAN: True to scan for available serial ports.
    Returns:
        PORTS: Available serial ports.
"""

ghenv.Component.Name = "Funken_Scan Serial Ports"
ghenv.Component.NickName = 'ScanPorts'
ghenv.Component.Message = 'VER 0.3.3'
ghenv.Component.IconDisplayMode = ghenv.Component.IconDisplayMode.application
ghenv.Component.Category = "Funken"
ghenv.Component.SubCategory = "0 | Funken"
try: ghenv.Component.AdditionalHelpFromDocStrings = "1"
except: pass

import platform
import Grasshopper as gh


## SERIAL PORT SCAN - WINDOWS
## https://eli.thegreenplace.net/2009/07/31/listing-all-serial-ports-on-windows-with-python/
def enumerate_serial_ports_win():
    """ Uses the Win32 registry to return an
        iterator of serial (COM) ports
        existing on this computer.
    """
    
    import _winreg as winreg
    import itertools
    
    path = 'HARDWARE\\DEVICEMAP\\SERIALCOMM'
    try:
        key = winreg.OpenKey(winreg.HKEY_LOCAL_MACHINE, path)
    except WindowsError:
        return
        #raise IterationError
    ports = []
    for i in itertools.count():
        try:
            val = winreg.EnumValue(key, i)
            port_name = str(val[1])
            if port_name not in ports:
                ports.append(port_name)
        except EnvironmentError:
            break
    return ports

## SERIAL PORT SCAN - MAC
def enumerate_serial_ports_mac():
    import glob
    ports = glob.glob("/dev/tty.*")
    return ports


if SCAN:
    os_name = platform.system()
    
    if os_name == "Darwin":
        PORTS = enumerate_serial_ports_mac()
    else:
        try:
            PORTS = enumerate_serial_ports_win()
        except:
            msg = "Your operative system is currently not supported by Funken.\n You might try to write the name of the serial port manually to the OpenPort component."
            ghenv.Component.AddRuntimeMessage(gh.Kernel.GH_RuntimeMessageLevel.Error, msg)
# ---------- end scanports ----------
timer = Timer(TimerInterval=50, Target=digitalread)  # disabled
pinmode_2 = Funken_SetPinMode(PIN=number_slider, MODE=pinmode, SET=Button())  # -> COMM, PORT, ID; inputs MODE: Int32, SET: Boolean, ID: Int32
# ---------- pinmode_2: Python ----------
#########################################################################
##                            COMPONENT INFO                           ##
#########################################################################

"""
Set pin mode (mirrors the Arduino pinMode method).
-
Provided by Funken 0.3
    Args:
        PIN: The number of the pin whose mode you wish to set.
        MODE: 0 for Input pins, 1 for Output pins.
        SET: True to set the pin.
        PORT: Serial port to send the message [Default is the first port available].
        ID: ID of the device [Default is the first device available].
    Returns:
        _COMM: Funken command.
        _PORT: Serial port where the message was sent (for daisy-chaining). 
        _ID: Device ID (for daisy-chaining). 
"""

ghenv.Component.Name = "Funken_Set PinMode"
ghenv.Component.NickName = 'PinMode'
ghenv.Component.Message = 'VER 0.3.3'
ghenv.Component.IconDisplayMode = ghenv.Component.IconDisplayMode.application
ghenv.Component.Category = "Funken"
ghenv.Component.SubCategory = "1 | Arduino"
try: ghenv.Component.AdditionalHelpFromDocStrings = "1"
except: pass

import scriptcontext as sc
import Grasshopper as gh

def main(pin, mode, set, port, id):
    
    check_data = True
    
    if sc.sticky.has_key("pyFunken") == False:
        check_data = False
        msg = "No serial object available. Have you opened the serial port?"
        ghenv.Component.AddRuntimeMessage(gh.Kernel.GH_RuntimeMessageLevel.Warning, msg)
        return
    
    if pin is None:
        check_data = False
        msg = "No pin provided."
        ghenv.Component.AddRuntimeMessage(gh.Kernel.GH_RuntimeMessageLevel.Warning, msg)
        return
    
    if mode is None:
        check_data = False
        msg = "No mode provided."
        ghenv.Component.AddRuntimeMessage(gh.Kernel.GH_RuntimeMessageLevel.Warning, msg)
        return
    
    if set is None:
        set = False
    
    if port is None:
        if len(sc.sticky["pyFunken"].com_ports) == 0:
            msg = "No serial connection available. Did you connect open the serial port?"
            ghenv.Component.AddRuntimeMessage(gh.Kernel.GH_RuntimeMessageLevel.Warning, msg)
            return
        else:
            port = sc.sticky["pyFunken"].com_ports[0]
    
    if id is None:
        if len(sc.sticky['pyFunken'].ser_conn[port].devices_ids) == 0:
            msg = "No device available. Did you connect an Arduino-compatible device and registered it?"
            ghenv.Component.AddRuntimeMessage(gh.Kernel.GH_RuntimeMessageLevel.Warning, msg)
            return
        else:
            id = sc.sticky['pyFunken'].ser_conn[port].devices_ids[0]
    
    if check_data:
        comm = "PM " + str(pin) + " " + str(mode) + "\n"
        if set:
            sc.sticky['pyFunken'].send_command(comm, port, id)
        
        return comm, port, id

result = main(PIN, MODE, SET, PORT, ID)

if result is not None:
    _COMM = result[0]
    _PORT = result[1]
    _ID = result[2]
# ---------- end pinmode_2 ----------
merge = Merge(Data1=servo_num, Data2=servo_pin, Data3=servo_angle)
servo_angle_2 = Slider(77, range=0..180)
servo_num_2 = Slider(1, range=1..3)
panel = Panel(scanports)
digitalread = Funken_DigitalRead(PIN=number_slider, GET=Toggle(True))  # -> VAL, COMM, PORT, ID; inputs PIN: Int32, GET: Boolean
# ---------- digitalread: Python ----------
#########################################################################
##                            COMPONENT INFO                           ##
#########################################################################

"""
Read a digital input pin (mirrors the Arduino digitalRead method).
-
Provided by Funken 0.3
    Args:
        PIN: The number of the pin from which to read.
        GET: True to read data.
        PORT: Serial port to send the message [Default is the first port available].
        ID: ID of the device [Default is the first device available].
    Returns:
        VAL: Read value.
        _COMM: Funken command.
        _PORT: Serial port where the message was sent (for daisy-chaining). 
        _ID: Device ID (for daisy-chaining). 
"""

ghenv.Component.Name = "Funken_Digital Read"
ghenv.Component.NickName = 'DigitalRead'
ghenv.Component.Message = 'VER 0.3.3'
ghenv.Component.IconDisplayMode = ghenv.Component.IconDisplayMode.application
ghenv.Component.Category = "Funken"
ghenv.Component.SubCategory = "1 | Arduino"
try: ghenv.Component.AdditionalHelpFromDocStrings = "2"
except: pass

import scriptcontext as sc
import Grasshopper as gh
import time

def main(pin, get, port, id):
    
    if sc.sticky.has_key("pyFunken") == False:
        check_data = False
        msg = "No serial object available. Have you opened the serial port?"
        ghenv.Component.AddRuntimeMessage(gh.Kernel.GH_RuntimeMessageLevel.Warning, msg)
        return
    
    if pin is None:
        check_data = False
        msg = "No pin provided."
        ghenv.Component.AddRuntimeMessage(gh.Kernel.GH_RuntimeMessageLevel.Warning, msg)
        return
    
    if get is None:
        get = False
    
    if port is None:
        if len(sc.sticky["pyFunken"].com_ports) == 0:
            msg = "No serial connection available. Did you connect open the serial port?"
            ghenv.Component.AddRuntimeMessage(gh.Kernel.GH_RuntimeMessageLevel.Warning, msg)
            return
        else:
            port = sc.sticky["pyFunken"].com_ports[0]
    
    if id is None:
        if len(sc.sticky['pyFunken'].ser_conn[port].devices_ids) == 0:
            msg = "No device available. Did you connect an Arduino-compatible device and registered it?"
            ghenv.Component.AddRuntimeMessage(gh.Kernel.GH_RuntimeMessageLevel.Warning, msg)
            return
        else:
            id = sc.sticky['pyFunken'].ser_conn[port].devices_ids[0]
    
    value = None
    comm = "DR " + str(pin) + "\n"
    if get:
        response = sc.sticky['pyFunken'].get_response(comm, "DR", port, id)
        try:
            value = int(response.split(" ")[1])
        except:
            value = -1
        
    return value, comm, port, id

result = main(PIN, GET, PORT, ID)

if result is not None:
    VAL = result[0]
    _COMM = result[1]
    _PORT = result[2]
    _ID = result[3]
# ---------- end digitalread ----------
customcomm = Funken_CustomCommand(TOKEN="ATTACHSRV", VAL=merge, RES=Toggle(False), SEND=Button())  # -> OUT, OUT_RAW, COMM, PORT, ID; inputs VAL: list, RES: Boolean, SEND: Boolean
# ---------- customcomm: Python ----------
#########################################################################
##                            COMPONENT INFO                           ##
#########################################################################

"""
Send custom Funken commands.
-
Provided by Funken 0.3
    Args:
        TOKEN: Command identification token.
        VAL: Command parameters.
        RES: True if the command is expecting a response.
        SEND: True to send the command.
        PORT: Serial port to send the message [Default is the first port available].
        ID: ID of the device [Default is the first device available].
    Returns:
        OUT: Parsed command output (as list).
        OUT_RAW: Raw command output (as string).
        _COMM: Funken command.
        _PORT: Serial port where the message was sent (for daisy-chaining). 
        _ID: Device ID (for daisy-chaining). 
"""

ghenv.Component.Name = "Funken_CustomCommand"
ghenv.Component.NickName = 'CustomComm'
ghenv.Component.Message = 'VER 0.3.3'
ghenv.Component.IconDisplayMode = ghenv.Component.IconDisplayMode.application
ghenv.Component.Category = "Funken"
ghenv.Component.SubCategory = "2 | Custom"
try: ghenv.Component.AdditionalHelpFromDocStrings = "1"
except: pass

import scriptcontext as sc
import Grasshopper as gh
import time

def main(token, values, return_data, send_data, port, id):
    
    if sc.sticky.has_key("pyFunken") == False:
        check_data = False
        msg = "No serial object available. Have you opened the serial port?"
        ghenv.Component.AddRuntimeMessage(gh.Kernel.GH_RuntimeMessageLevel.Warning, msg)
        return
    
    if return_data is None:
        return_data = False
    
    if send_data is None:
        send_data = False
    
    if port is None:
        if len(sc.sticky["pyFunken"].com_ports) == 0:
            msg = "No serial connection available. Did you connect open the serial port?"
            ghenv.Component.AddRuntimeMessage(gh.Kernel.GH_RuntimeMessageLevel.Warning, msg)
            return
        else:
            port = sc.sticky["pyFunken"].com_ports[0]
    
    if id is None:
        if len(sc.sticky['pyFunken'].ser_conn[port].devices_ids) == 0:
            msg = "No device available. Did you connect an Arduino-compatible device and registered it?"
            ghenv.Component.AddRuntimeMessage(gh.Kernel.GH_RuntimeMessageLevel.Warning, msg)
            return
        else:
            id = sc.sticky['pyFunken'].ser_conn[port].devices_ids[0]
    
    response = None
    comm = token
    for v in values:
        comm = comm + " " + str(v)
    comm = comm + "\n"
    if send_data:
        if return_data:
            response = sc.sticky['pyFunken'].get_response(comm, token, port, id)
        else:
            sc.sticky['pyFunken'].send_command(comm, port, id)
    
    return response, comm, port, id


result = main(TOKEN, VAL, RES, SEND, PORT, ID)

if result is not None:
    OUT_RAW = result[0]
    if result[0] is not None:
        OUT = result[0].split(" ")
    else:
        OUT = None
    _COMM = result[1]
    _PORT = result[2]
    _ID = result[3]
# ---------- end customcomm ----------
rest_angle = Slider(0, range=0..180)
active_angle = Slider(90, range=0..180)
baudrates = Funken_Baudrates({"300", "1200", "2400", "4800", "9600", "19200", "38400", "57600", "74880", "115200", "230400", "250000", "500000", "1000000", "2000000"}, selected="57600")
merge_2 = Merge(Data1=servo_num_2, Data2=servo_angle_2)
panel_2 = Panel(digitalread.VAL)
customcomm_2 = Funken_CustomCommand(TOKEN="SRV", VAL=merge_2, RES=Toggle(False), SEND=Toggle(True))  # -> OUT, OUT_RAW, COMM, PORT, ID; inputs VAL: list, RES: Boolean, SEND: Boolean; same code as customcomm
openport = Funken_OpenSerialPort(PORT=panel, BAUD=baudrates, OPEN=Button(), REG=Button())  # -> LOG; inputs PORT: list, BAUD: list of Int32, OPEN: Boolean
# ---------- openport: Python ----------
#########################################################################
##                            COMPONENT INFO                           ##
#########################################################################

"""
Open a serial port and register avaialble Funken devices.
-
Provided by Funken 0.3
    Args:
        
        PORT: Serial port to open.
        BAUD: Communication baudrate [Funken default: 57600].
        OPEN: True to open the port for communication.
        REG: Register devices to access available Funken commands. Sometimes the connection takes some time to be established, so you might need to press this button 2-3 times.
    Returns:
        LOG: Information about connected devices.
"""

ghenv.Component.Name = "Funken_Open Serial Port"
ghenv.Component.NickName = 'OpenPort'
ghenv.Component.Message = 'VER 0.3.3'
ghenv.Component.IconDisplayMode = ghenv.Component.IconDisplayMode.application
ghenv.Component.Category = "Funken"
ghenv.Component.SubCategory = "0 | Funken"
try: ghenv.Component.AdditionalHelpFromDocStrings = "1"
except: pass


import sys
import scriptcontext as sc
import Grasshopper as gh
import time

## add Funken install directory to system path
ghcompfolder = gh.Folders.DefaultAssemblyFolder
fnk_path = ghcompfolder + "GhFunken"
if fnk_path not in sys.path:
    sys.path.append(fnk_path)
try:
    import funken
except:
    msg = "Cannot import Funken. Is the funken.py module installed in " + fnk_path + "?"
    ghenv.Component.AddRuntimeMessage(gh.Kernel.GH_RuntimeMessageLevel.Error, msg)


def main(ports, bauds, open, register, log):
    
    check_data = True
    
    if len(ports) == 0:
        check_data = False
        msg = "No serial port provided."
        ghenv.Component.AddRuntimeMessage(gh.Kernel.GH_RuntimeMessageLevel.Warning, msg)
    
    if len(bauds) == 0:
        bauds = [57600]
    
    elif len(bauds) > 1 and len(bauds) != len(ports):
        check_data = False
        msg = "Wrong number of comports and baudrates."
        ghenv.Component.AddRuntimeMessage(gh.Kernel.GH_RuntimeMessageLevel.Error, msg)
    
    if open is None:
        open = False
    
    if register is None:
        register = False
    
    if check_data:
        
        if sc.sticky.has_key("pyFunken") == False:
            sc.sticky['pyFunken'] = funken.PyFunken([],[])
        
        if open:
            log = ""
            for i in xrange(len(ports)):
                if ports[i] is not None:
                    baud = None
                    if len(bauds) == 1:
                        baud = bauds[0]
                    else:
                        baud = bauds[i]
                    try:
                        sc.sticky['pyFunken'].add_serial_connection(ports[i], baud)
                        log = log + str(ports[i]) + ":\n" + "No Funken device registered\n"
                        log = log + "---\n"
                    except:
                        log = log + str(ports[i]) + ":\n" + "Could not open the serial port\n"
                        log = log + "---\n"
        
        if register:
            log = ""
            for port in ports:
                try:
                    sc.sticky['pyFunken'].ser_conn[port].register_devices()
                    log = log + str(sc.sticky['pyFunken'].ser_conn[port].port) + ":\n"
                    if len(sc.sticky['pyFunken'].ser_conn[port].devices) > 0:
                        for device in sc.sticky['pyFunken'].ser_conn[port].devices:
                            log = log + str(device) + ":" + str(sc.sticky['pyFunken'].ser_conn[port].devices[device].tokens.keys()) + "\n"
                    else:
                        log = log + "No Funken device available\n"
                
                except:
                    log = log + str(port) + ":\n" + "Could not open the serial port\n"
                    
                log = log + "---\n"
    
    ## test if available serial ports are still active
    if sc.sticky.has_key("pyFunken"):
        
        ## remove port names if no longer in use
        for port in sc.sticky['pyFunken'].com_ports:
            if sc.sticky['pyFunken'].ser_conn.has_key(port) == False:
                sc.sticky['pyFunken'].com_ports =  filter(lambda a: a != port, sc.sticky['pyFunken'].com_ports)
        
        ## remove serial connections if no longer available
        removed_keys = []
        for port in sc.sticky['pyFunken'].ser_conn:
            for device in sc.sticky['pyFunken'].ser_conn[port].devices:
                try:
                    sc.sticky['pyFunken'].send_command("TEST", port, device)
                except:
                    removed_keys.append(port)
                    if port in sc.sticky['pyFunken'].com_ports:
                        sc.sticky['pyFunken'].com_ports.remove(port) 
                    break
        for key in removed_keys:
            sc.sticky['pyFunken'].ser_conn.pop(key)
    
    return log


if 'logger' not in globals():
    logger = ""

logger = main(PORT, BAUD, OPEN, REG, logger)
LOG = logger
# ---------- end openport ----------
filter = StreamFilter(Gate=panel_2, Stream0=rest_angle, Stream1=active_angle)
servo_num_3 = Slider(1, range=1..3)
panel_3 = Panel(openport)
merge_3 = Merge(Data1=servo_num_3, Data2=filter)
customcomm_3 = Funken_CustomCommand(TOKEN="SRV", VAL=merge_3, RES=Toggle(False), SEND=Toggle(True))  # -> OUT, OUT_RAW, COMM, PORT, ID; inputs VAL: list, RES: Boolean, SEND: Boolean; same code as customcomm
